# Dynamo graph PrintedGeometry_clean.dyn (Dynamo 2.10.1.3976)

# group: Pick Elements
select_model_elements_by = DSModelElementsByCategorySelection(index=686)  # "Select Model Elements By Category"; 3 picked in the model
watch = Watch(select_model_elements_by)

# group: Evaluate selected walls
pick_evaluate_adjust = Custom[Pick_evaluate_adjust](dict=watch)  # Pick wall elelements, evaluate optimization opportunity, adjust layers and thicknesses
code_block = CodeBlock { null; }
if_ = If(test=pick_evaluate_adjust.Error, true=code_block, false=pick_evaluate_adjust.Elements)
watch_2 = Watch(pick_evaluate_adjust.Elements_name)
alert_Popout = Custom[Alert_Popout](Error=pick_evaluate_adjust.Error, Error_Text=pick_evaluate_adjust.Error_Text)  # Show alerts from the code

# group: Thicknesses update
update_thicknesses = Custom[Update_thicknesses](dict=if_)  # Updating thicknesses of selected elements
watch_3 = Watch(update_thicknesses.Wall_Thickness)
watch_4 = Watch(if_)

# group: Extract Solid and necessary parameters from Wall
geometry = Element.Geometry(element=update_thicknesses.Elements)
flatten = List.Flatten(list=geometry)
byUnion = Solid.ByUnion(solids=flatten)
byGeometry = BoundingBox.ByGeometry(geom=byUnion)
maxPoint = BoundingBox.MaxPoint(boundingBox=byGeometry)
Z = Point.Z(point=maxPoint)
extract_height_and_width = CodeBlock(element=update_thicknesses.Elements)
# ---------- extract_height_and_width.designscript (4 lines) ----------
firstE = List.FirstItem(element);
height = Element.GetParameterValueByName(firstE,"Unconnected Height");
type = Element.GetParameterValueByName(firstE, "Type");
width = Element.GetParameterValueByName(type, "Width");
# ----------------------------------------
number_of_wall_parts = List.Count(list=flatten)
centerSurface = Custom[CenterSurface](wallSolid=byUnion, wallWidth=extract_height_and_width.width)  # Extracts center surface of a solid

# group: Layers by intersection with xy-Planes
string = StringInput("layerH")
findByName = GlobalParameter.FindByName(name=string)
value = GlobalParameter.Value(globalParameter=findByName)
reduce_height_for_testing_m = DoubleSlider(0, range=0..3 step 0.01)
create_planes_for_intersection = CodeBlock(layerH=value, height=Z, redH=reduce_height_for_testing_m, wallSolid=byUnion, wallThickness=extract_height_and_width.width)
# ---------- create_planes_for_intersection.designscript (28 lines) ----------
planeZ=layerH..height-redH..layerH;
o=Point.ByCoordinates(0,0,planeZ);
planesT=Plane.ByOriginNormal(o,Vector.ZAxis());
// if plane is at uppermost position of the geometry, intersection causes errors
z=List.LastItem(planeZ);
p=Point.ByCoordinates(0,0,z-0.001);
planes = [Imperative]{
if (z != height) {
return planesT;
}
else {
newPlane=Plane.ByOriginNormal(p,Vector.ByCoordinates(0,0,1));
i=List.IndexOf(planesT,List.LastItem(planesT));
return List.ReplaceItemAtIndex(planesT,i,newPlane);
};
};
// cut geometry with horizontal planes
horizontalCut = List.Flatten(Geometry.Intersect(wallSolid,planes),-1);
curves = Surface.PerimeterCurves(horizontalCut);
// shift longest side to idx 0
l = Curve.Length(curves);
maxL = List.MaximumItem(l);
idxMax = -List.IndexOf(l@L2<1>, maxL@L1<1>);
curveList = List.ShiftIndices(curves@L2<1>, idxMax@L1<1>);
// if there are more than one longest curves:
test = ((List.FirstItem(curveList).Length) - wallThickness) > 0.0001;
shift = 1 - (List.FirstIndexOf(test, false));
List.ShiftIndices(curveList@L2<1>, shift);
# ----------------------------------------
geometry_intersect_center = Geometry.Intersect(geometry=centerSurface.centerSurface, other=create_planes_for_intersection.out5)  # "Geometry.Intersect: center surface"

zigzag_angle = IntegerSlider(60, range=15..75 step 5)

# group: Pathplanning
number_of_extra_perimeters = IntegerSlider(0, range=0..5 step 1)
opening_position = DoubleSlider(0.5, range=0.02..1 step 0.01)
get_printer_parameters = CodeBlock()
# ---------- get_printer_parameters.designscript (4 lines) ----------
lH = GlobalParameter.FindByName("layerH");
GlobalParameter.Value(lH);
nD = GlobalParameter.FindByName("nozzleD");
GlobalParameter.Value(nD);
# ----------------------------------------
multiPerimeterPath = Custom[MultiPerimeterPath](perimeter=create_planes_for_intersection.out14, numberOfSolids=number_of_wall_parts, limit=number_of_extra_perimeters, position=opening_position, layerH=get_printer_parameters.out1, nozzleD=get_printer_parameters.out3)  # Creates perimeter path with x inner offsets
number_of_divisions = IntegerSlider(20, range=3..50 step 2)
innerZickZack = Custom[InnerZickZack](dict=multiPerimeterPath, divisions=number_of_divisions, wall_thickness=watch_3, angle=zigzag_angle)  # Creates an inner zick zack path from a perimeter path.
dictToVar = Custom[DictToVar](dict=innerZickZack)  # Extracts dictionary content
number_of_divisions_2 = IntegerSlider(60, range=4..100 step 2)
innerRibs = Custom[InnerRibs](dict=multiPerimeterPath, divisions=number_of_divisions_2)  # frozen
dictToVar_2 = Custom[DictToVar](dict=innerRibs)

# group: extract printing path points for robot control
explode = Geometry.Explode(geometry=dictToVar.path)
number_slider = DoubleSlider(0.1, range=0.01..0.5 step 0.01)
length = Curve.Length(curve=explode)
code_block_2 = CodeBlock(x=number_slider, y=length) { a=x/y; 0..1..a; }
splitByParameter = Curve.SplitByParameter(curve=explode, parameters=code_block_2.out1)
endPoint = Curve.EndPoint(curve=splitByParameter)
flatten_2 = List.Flatten(list=endPoint)
byPoints = PolyCurve.ByPoints(points=flatten_2)
explode_2 = Geometry.Explode(geometry=byPoints)

# group: Translate to Origin
minPoint = BoundingBox.MinPoint(boundingBox=byGeometry)
code_block_3 = CodeBlock(p=minPoint) { -Point.X(p); -Point.Y(p); }
translate = Geometry.Translate(geometry=dictToVar.path, xTranslation=code_block_3.out0, yTranslation=code_block_3.out1)

# group: path finish and solid sweep, does not always work and takes some time to execute
drawPrintedGeometry = Custom[DrawPrintedGeometry]()  # frozen; Creates a solid from a printing path by swiping a cross section along the path.; unwired: printingPath, nozzleD, layerH
get_printer_parameters_2 = CodeBlock()  # same code as get_printer_parameters
input_and_inter_layer_curves = CodeBlock(curve=translate)  # frozen
# ---------- input_and_inter_layer_curves.designscript (6 lines) ----------
curve;
List.FirstItem(PolyCurve.NumberOfCurves(curve));
nol = List.Count(curve)-1;
p1 = List.TakeItems(Curve.EndPoint(curve),nol);
p2 = List.RestOfItems(Curve.StartPoint(curve));
Line.ByStartPointEndPoint(p1,p2);
# ----------------------------------------
explode_3 = Geometry.Explode(geometry=input_and_inter_layer_curves.curve)
regularCrossSection = Custom[RegularCrossSection](nozzleSize=get_printer_parameters_2.out3, layerThickness=get_printer_parameters_2.out1, geometry=explode_3@L2, numberOfCurves=input_and_inter_layer_curves.out1)  # Creates a cross section of a 3D printing layer
startPoint = Curve.StartPoint(curve=regularCrossSection.revolveCrossSection)
code_block_4 = CodeBlock { 360; }
byRevolve = Solid.ByRevolve(profile=regularCrossSection.revolveCrossSection@L2, axisOrigin=startPoint@L2, sweepAngle=code_block_4)
byUnion_2 = Solid.ByUnion(solids=byRevolve@L2)  # frozen
byUnion_3 = Solid.ByUnion(solids=byUnion_2)  # frozen
bySweep = Solid.BySweep(profile=regularCrossSection.crossSection, path=explode_3)
byUnion_4 = Solid.ByUnion(solids=bySweep)  # frozen
byUnion_5 = Solid.ByUnion(solids=byUnion_4)
union = Solid.Union(solid=byUnion_3, solid_2=byUnion_5)
join = List.Join()  # unwired: list0, list1
code_block_5 = CodeBlock(endCS=regularCrossSection.crossSection, nol=input_and_inter_layer_curves.nol) { List.RestOfItems(List.FirstItem(endCS@L2<1>)); List.TakeItems(List.Flatten(ilCS,-1),nol); }  # frozen; unwired: ilCS
combine = List.Combine(comb=join, list1=code_block_5.out1, list2=code_block_5.out0)
byLoft = Solid.ByLoft(crossSections=combine)
byUnion_6 = Solid.ByUnion(solids=byLoft)  # frozen
union_2 = Solid.Union(solid=union, solid_2=byUnion_6)
volume = Solid.Volume(solid=union_2)
code_block_6 = CodeBlock { 0; 1; 2; 2.5; 5; }  # frozen
byCoordinates = Point.ByCoordinates(x=code_block_6.out2, y=code_block_6.out0, z=code_block_6.out0)
byCoordinates_2 = Point.ByCoordinates(x=code_block_6.out4, y=code_block_6.out3, z=code_block_6.out1)
byCorners = Cuboid.ByCorners(lowPoint=byCoordinates, highPoint=byCoordinates_2)
differenceAll = Solid.DifferenceAll(solid=byCorners, others=byUnion_5)
differenceAll_2 = Solid.DifferenceAll(solid=differenceAll, others=byUnion_6)
differenceAll_3 = Solid.DifferenceAll(solid=byCorners, others=differenceAll_2)

# group: Parameters
string_2 = StringInput("nozzleD")
select_parameter_type = ParameterType()  # nothing selected
byName = GlobalParameter.ByName(name=string_2, parameterType=select_parameter_type)
nozzle_size_m = DoubleSlider(0.03, range=0.01..0.4 step 0.005)
setValue = GlobalParameter.SetValue(parameter=byName, value=nozzle_size_m)
string_3 = StringInput("layerH")
select_parameter_type_2 = ParameterType()  # nothing selected
byName_2 = GlobalParameter.ByName(name=string_3, parameterType=select_parameter_type_2)
layer_thickness_m = DoubleSlider(0.025, range=0.01..0.4 step 0.005)
setValue_2 = GlobalParameter.SetValue(parameter=byName_2, value=layer_thickness_m)

code_block_7 = CodeBlock { null; 0; }
dictToVar_3 = Custom[DictToVar]()  # frozen; unwired: dict
number_of_divisions_3 = IntegerSlider(80, range=4..100 step 2)

# group: inner Zick Zack ... DEBUG
createAccess = Custom[CreateAccess](nozzleD=dictToVar_3.nozzleD, outerPrintingPath=dictToVar_3.path, accessIdx=dictToVar_3.accIdx)  # Cuts surrounding printing path at access point and returns access geometry
create_perimeter_offset_and = CodeBlock(perimeter=dictToVar_3.perimeter, nozzleD=dictToVar_3.nozzleD, reversed=dictToVar_3.reversed, nos=dictToVar_3.numberOfSolids)  # "Create perimeter offset and reverse it if necessary"
# ---------- create_perimeter_offset_and.designscript (34 lines) ----------
offPer = Autodesk.DesignScript.Geometry.Curve.Offset(perimeter,-nozzleD);
exPer = Geometry.Explode(offPer);
!reversed;
nos;
outerPer = [Imperative]{
if (!reversed)
{
reverted=[];
for (i in 0..List.Count(exPer)-1)
{
reverted[i]=List.Reverse(exPer[i]);
}
return PolyCurve.Reverse(reverted);
}
else
{
return exPer;
}
};
shiftIdx = [Imperative]{
if (!reversed)
{
return 1;
}
else
{
return nos-1;
}
};
outer = List.ShiftIndices(outerPer@L2<1>,shiftIdx);
outerPoly = PolyCurve.ByJoinedCurves(outer,0.0001);
offOuter = Autodesk.DesignScript.Geometry.Curve.Offset(outerPoly,-nozzleD);
inner = Geometry.Explode(offOuter);
middleCurve = List.GetItemAtIndex(outer@L2<1>,nos);
# ----------------------------------------
removeSides = Custom[RemoveSides](geometry=create_perimeter_offset_and.out6, numberOfSolids=dictToVar_3.numberOfSolids)  # Removes the sides of a perimeter curve by bool mask.
code_block_8 = CodeBlock(c=removeSides.outerBorder, nozzleD=dictToVar_3.nozzleD)
# ---------- code_block_8.designscript (4 lines) ----------
curves = PolyCurve.Curves(c);
len = Autodesk.DesignScript.Geometry.Curve.Length(curves);
off1 = nozzleD/len;
off2 = 1-off1;
# ----------------------------------------
trimByParameter = Curve.TrimByParameter(curve=code_block_8.curves@L2, startParameter=code_block_8.off1@L2, endParameter=code_block_8.off2@L2)
transpose = List.Transpose(lists=trimByParameter)
pointsAtEqualSegmentLength = Curve.PointsAtEqualSegmentLength(curve=transpose, divisions=number_of_divisions_3)
removeSides_2 = Custom[RemoveSides](geometry=create_perimeter_offset_and.out9, numberOfSolids=dictToVar_3.numberOfSolids)
code_block_9 = CodeBlock(c=removeSides_2.innerBorder, nozzleD=dictToVar_3.nozzleD)  # same code as code_block_8
trimByParameter_2 = Curve.TrimByParameter(curve=code_block_9.curves@L2, startParameter=code_block_9.off1@L2, endParameter=code_block_9.off2@L2)
transpose_2 = List.Transpose(lists=trimByParameter_2)
closestPointTo = Geometry.ClosestPointTo(geometry=transpose_2, other=pointsAtEqualSegmentLength)
byStartPointEndPoint = Line.ByStartPointEndPoint(startPoint=pointsAtEqualSegmentLength, endPoint=closestPointTo)
code_block_10 = CodeBlock { 2; 1; }
takeEveryNthItem = List.TakeEveryNthItem(list=byStartPointEndPoint@L2, n=code_block_10.out0, offset=code_block_10.out1)
takeEveryNthItem_2 = List.TakeEveryNthItem(list=byStartPointEndPoint@L2, n=code_block_10.out0)
count = List.Count(list=pointsAtEqualSegmentLength@L2)
code_block_11 = CodeBlock(x=count) { x-1; }
takeItems = List.TakeItems(list=pointsAtEqualSegmentLength@L2, amount=code_block_11@L1)
restOfItems = List.RestOfItems(list=pointsAtEqualSegmentLength@L2)
distanceTo = Geometry.DistanceTo(geometry=takeItems@L2, other=restOfItems@L2)
code_block_12 = CodeBlock(dist=distanceTo, nozzleD=dictToVar_3.nozzleD, c=takeEveryNthItem_2)
# ---------- code_block_12.designscript (8 lines) ----------
fdist = List.Flatten(dist);
r = Math.Round(List.FirstItem(fdist),4) - nozzleD/2;
l = Curve.Length(c);
par = r/l;
vec1 = Line.Direction(c);
vec2 = Vector.YAxis();
angle1 = Vector.AngleWithVector(vec1,vec2) - 180;
angle2 = angle1 + 180;
# ----------------------------------------
trimByStartParameter = Curve.TrimByStartParameter(curve=takeEveryNthItem_2, startParameter=code_block_12.par)
startPoint_2 = Curve.StartPoint(curve=trimByStartParameter)
byCenterPointRadiusAngle = Arc.ByCenterPointRadiusAngle(center=startPoint_2, radius=code_block_12.r, startAngle=code_block_12.angle1, endAngle=code_block_12.angle2)
code_block_13 = CodeBlock { true; false; }
startCurve = Custom[StartCurve](perimeter=dictToVar_3.perimeter, reverse=dictToVar_3.reversed, numberOfSolids=dictToVar_3.numberOfSolids, nozzleD=dictToVar_3.nozzleD)  # Creates a offset curve that connects to the outer perimeter
startPoint_3 = Curve.StartPoint(curve=trimByParameter@L1)
parameterAtPoint = Curve.ParameterAtPoint(curve=startCurve, point=startPoint_3)
trimByEndParameter = Curve.TrimByEndParameter(curve=startCurve, endParameter=parameterAtPoint)
endPoint_2 = Curve.EndPoint(curve=transpose@L2)
startPoint_4 = Curve.StartPoint(curve=create_perimeter_offset_and.out10@L2)
byStartPointEndPoint_2 = Line.ByStartPointEndPoint(startPoint=endPoint_2@L1, endPoint=startPoint_4@L1)
code_block_14 = CodeBlock(geo=create_perimeter_offset_and.out6, nozzleD=dictToVar_3.nozzleD)
# ---------- code_block_14.designscript (3 lines) ----------
c=List.LastItem(geo@L2<1>);
startPar=1-nozzleD/Autodesk.DesignScript.Geometry.Curve.Length(c);
Autodesk.DesignScript.Geometry.Curve.TrimByEndParameter(c,startPar);
# ----------------------------------------
endPoint_3 = Curve.EndPoint(curve=code_block_14.out2)
byStartPointEndPoint_3 = Line.ByStartPointEndPoint(startPoint=endPoint_3, endPoint=createAccess.accessPoint)

count_2 = List.Count(list=closestPointTo@L2)
code_block_15 = CodeBlock(x=count_2) { x-1; }
takeItems_2 = List.TakeItems(list=closestPointTo@L2, amount=code_block_15@L1)
restOfItems_2 = List.RestOfItems(list=closestPointTo@L2)
distanceTo_2 = Geometry.DistanceTo(geometry=takeItems_2@L2, other=restOfItems_2@L2)

# group (continued): inner Zick Zack ... DEBUG
code_block_16 = CodeBlock(dist=distanceTo_2, nozzleD=dictToVar_3.nozzleD, c=takeEveryNthItem)
# ---------- code_block_16.designscript (8 lines) ----------
fdist = List.Flatten(dist);
r = Math.Round(List.FirstItem(fdist),4) - nozzleD/2;
l = Curve.Length(c);
par = (l-r)/l;
vec1 = Line.Direction(c);
vec2 = Vector.YAxis();
angle1 = Vector.AngleWithVector(vec1,vec2) - 180;
angle2 = angle1 + 180;
# ----------------------------------------
trimByEndParameter_2 = Curve.TrimByEndParameter(curve=takeEveryNthItem, endParameter=code_block_16.par)
endPoint_4 = Curve.EndPoint(curve=trimByEndParameter_2)
byCenterPointRadiusAngle_2 = Arc.ByCenterPointRadiusAngle(center=endPoint_4, radius=code_block_16.r, startAngle=code_block_16.angle2, endAngle=code_block_16.angle1)
firstItem = List.FirstItem(list=byCenterPointRadiusAngle_2@L2)
restOfItems_3 = List.RestOfItems(list=byCenterPointRadiusAngle_2@L2)
byBlendBetweenCurves = Curve.ByBlendBetweenCurves(curve1=byCenterPointRadiusAngle, curve2=restOfItems_3, endOrStart1=code_block_13.out1)
byBlendBetweenCurves_2 = Curve.ByBlendBetweenCurves(curve1=byCenterPointRadiusAngle_2, curve2=byCenterPointRadiusAngle, endOrStart2=code_block_13.out0)
join_2 = Curve.Join(curve=byBlendBetweenCurves_2@@L1, curves=byCenterPointRadiusAngle@L1)
join_3 = Curve.Join(curve=byBlendBetweenCurves@@L1, curves=join_2@L1)
join_4 = Curve.Join(curve=restOfItems_3@@L1, curves=join_3@L1)
join_5 = Curve.Join(curve=firstItem@L1, curves=join_4@L2)
byBlendBetweenCurves_3 = Curve.ByBlendBetweenCurves(curve1=firstItem, curve2=trimByEndParameter, endOrStart1=code_block_13.out1, endOrStart2=code_block_13.out0)
join_6 = Curve.Join(curve=join_5@L1, curves=byBlendBetweenCurves_3@L1)
lastItem = List.LastItem(list=byCenterPointRadiusAngle_2@L2)
byBlendBetweenCurves_4 = Curve.ByBlendBetweenCurves(curve1=lastItem@L1, curve2=byStartPointEndPoint_2@L1)
join_7 = Curve.Join(curve=join_6@L1, curves=byBlendBetweenCurves_4@L1)
code_block_17 = CodeBlock(zickZack=join_7, middleCurve=create_perimeter_offset_and.out10, zToMid=byStartPointEndPoint_2, firstPart=trimByEndParameter, sideBack=removeSides.innerBorder, last=code_block_14.out2, connect=byStartPointEndPoint_3)
# ---------- code_block_17.designscript (5 lines) ----------
p1 = Autodesk.DesignScript.Geometry.Curve.EndPoint(zickZack);
p2 = Autodesk.DesignScript.Geometry.Curve.StartPoint(middleCurve);
zToMid;
l = [firstPart,zickZack,zToMid,middleCurve,sideBack,last,connect];
PolyCurve.ByJoinedCurves(List.Transpose(l),0.01);
# ----------------------------------------
connect_inner_to_outer_path = CodeBlock(accCurve=createAccess.accessCurve, innerPer=code_block_17.out4, outerPath=dictToVar_3.path, accIdx=dictToVar_3.accIdx)
# ---------- connect_inner_to_outer_path.designscript (5 lines) ----------
innerPerAcc = List.ReplaceItemAtIndex(accCurve@L2<1>,1,innerPer@L1<1>);
innerPoly = PolyCurve.ByJoinedCurves(innerPerAcc@L2<1>,0.01);
outerPathEx = Geometry.Explode(outerPath);
totalPath = List.ReplaceItemAtIndex(outerPathEx@L2<1>,accIdx,innerPoly@L1<1>);
Autodesk.DesignScript.Geometry.Curve.Join(List.FirstItem(totalPath@L2<1>),List.RestOfItems(totalPath@L2<1>));
# ----------------------------------------

varToDict = Custom[VarToDict](perimeter=code_block_7.out0, path=connect_inner_to_outer_path.out4, accIdx=code_block_7.out1, reversed=create_perimeter_offset_and.out2, numberOfSolids=dictToVar_3.numberOfSolids, counter=code_block_7.out1, nozzleD=dictToVar_3.nozzleD)  # Creates dictionary from Variables

# group: unsymmetric test
division_position = DoubleSlider(0.02, range=-0.15..0.15 step 0.001)
splitInnerSurface = Custom[SplitInnerSurface](dict=multiPerimeterPath, division=division_position, centerSurface=centerSurface.centerSurface)

dictToVar_4 = Custom[DictToVar](dict=multiPerimeterPath)  # frozen
code_block_18 = CodeBlock { divisions: var[]..[]; }  # frozen; unwired: divisions

# group: inner Zick Zack
create_perimeter_offset_and_2 = CodeBlock(perimeter=dictToVar_4.perimeter, nozzleD=dictToVar_4.nozzleD, reversed=dictToVar_4.reversed, nos=dictToVar_4.numberOfSolids)  # "Create perimeter offset and reverse it if necessary"; same code as create_perimeter_offset_and
removesides_outer_perimeter = Custom[RemoveSides Outer Perimeter](geometry=create_perimeter_offset_and_2.out6, numberOfSolids=dictToVar_4.numberOfSolids)  # Removes the sides of a perimeter curve by bool mask.
code_block_19 = CodeBlock(c=removesides_outer_perimeter.outerBorder, nozzleD=dictToVar_4.nozzleD)  # same code as code_block_8
trimByParameter_3 = Curve.TrimByParameter(curve=code_block_19.curves@L2, startParameter=code_block_19.off1@L2, endParameter=code_block_19.off2@L2)
transpose_3 = List.Transpose(lists=trimByParameter_3)
pointsAtEqualSegmentLength_2 = Curve.PointsAtEqualSegmentLength(curve=transpose_3, divisions=code_block_18)
createAccess_2 = Custom[CreateAccess](nozzleD=dictToVar_4.nozzleD, outerPrintingPath=dictToVar_4.path, accessIdx=dictToVar_4.accIdx)
removesides_offset_perimeter = Custom[RemoveSides Offset Perimeter](geometry=create_perimeter_offset_and_2.out9, numberOfSolids=dictToVar_4.numberOfSolids)  # Removes the sides of a perimeter curve by bool mask.
code_block_20 = CodeBlock(c=removesides_offset_perimeter.innerBorder, nozzleD=dictToVar_4.nozzleD)  # same code as code_block_8
trimByParameter_4 = Curve.TrimByParameter(curve=code_block_20.curves@L2, startParameter=code_block_20.off1@L2, endParameter=code_block_20.off2@L2)
transpose_4 = List.Transpose(lists=trimByParameter_4)
code_block_21 = CodeBlock { 2; 1; }
startPoint_5 = Curve.StartPoint(curve=trimByParameter_3@L2)
transpose_5 = List.Transpose(lists=startPoint_5)
endPoint_5 = Curve.EndPoint(curve=trimByParameter_3@L2)
transpose_6 = List.Transpose(lists=endPoint_5)
startCurve_2 = Custom[StartCurve](perimeter=dictToVar_4.perimeter, reverse=dictToVar_4.reversed, numberOfSolids=dictToVar_4.numberOfSolids, nozzleD=dictToVar_4.nozzleD)
code_block_22 = CodeBlock(geo=create_perimeter_offset_and_2.out6, nozzleD=dictToVar_4.nozzleD)  # same code as code_block_14
endPoint_6 = Curve.EndPoint(curve=code_block_22.out2)
byStartPointEndPoint_4 = Line.ByStartPointEndPoint(startPoint=endPoint_6, endPoint=createAccess_2.accessPoint)

watch_5 = Watch(pointsAtEqualSegmentLength_2)
watch_6 = Watch(transpose_3)
length_2 = Curve.Length(curve=watch_6)
code_block_23 = CodeBlock(wall_thickness=update_thicknesses.Wall_Thickness) { wall_thickness: var[]..[]; }  # frozen
compensate_zigzag_location_in = CodeBlock(x=code_block_23, y=dictToVar_4.nozzleD) { x-(3*y); }  # "Compensate zigzag location in center"
code_block_24 = CodeBlock(angle=zigzag_angle) { angle: var[]..[]; }  # frozen
tan = Math.Tan(angle=code_block_24)
watch_7 = Watch(tan)
division_distance_between_two = compensate_zigzag_location_in / watch_7  # "Division - Distance between two points"
division_number_of_splits_for = length_2 / division_distance_between_two  # "Division - number of splits for each curve"
round_to_the_nearest_even_number = CodeBlock(a=division_number_of_splits_for) { Math.Round(a/2)*2; }
watch_8 = Watch(round_to_the_nearest_even_number)
list_flatten_possible_to_use = List.Flatten(list=watch_8)  # "List.Flatten Possible to use both 1st and second implementation"
code_block_25 = CodeBlock(PointsInput=list_flatten_possible_to_use)
# ---------- code_block_25.designscript (15 lines) ----------
PointsInput;
LastValue = PointsInput[0];
PointsUnique = [Imperative]{
unique = [];
unique = List.AddItemToEnd(PointsInput[0], unique);
for (i in 0..(List.Count(PointsInput)-1))
{
	if(PointsInput[i] != LastValue)
	{
		unique = List.AddItemToEnd(PointsInput[i], unique);
		LastValue = PointsInput[i];
	}
}
return unique;
};
# ----------------------------------------
watch_9 = Watch(code_block_25.out2)
transpose_7 = List.Transpose(lists=code_block_25.out2)
code_block_26 = CodeBlock { null; 0; }
pointsAtEqualSegmentLength_3 = Curve.PointsAtEqualSegmentLength(curve=transpose_3, divisions=watch_8)

# group (continued): inner Zick Zack
closestPointTo_2 = Geometry.ClosestPointTo(geometry=transpose_4, other=pointsAtEqualSegmentLength_3)
transpose_8 = List.Transpose(lists=closestPointTo_2@L3)
dropEveryNthItem = List.DropEveryNthItem(list=transpose_8@L3, n=code_block_21.out0)
transpose_9 = List.Transpose(lists=pointsAtEqualSegmentLength_3@L3)
dropEveryNthItem_2 = List.DropEveryNthItem(list=transpose_9@L3, n=code_block_21.out0, offset=code_block_21.out1)
byStartPointEndPoint_5 = Line.ByStartPointEndPoint(startPoint=dropEveryNthItem, endPoint=dropEveryNthItem_2)
restOfItems_4 = List.RestOfItems(list=dropEveryNthItem@L3)
byStartPointEndPoint_6 = Line.ByStartPointEndPoint(startPoint=dropEveryNthItem_2, endPoint=restOfItems_4)
firstItem_2 = List.FirstItem(list=dropEveryNthItem@L3)
byStartPointEndPoint_7 = Line.ByStartPointEndPoint(startPoint=transpose_5, endPoint=firstItem_2)
lastItem_2 = List.LastItem(list=dropEveryNthItem@L3)
byStartPointEndPoint_8 = Line.ByStartPointEndPoint(startPoint=lastItem_2, endPoint=transpose_6)

code_block_27 = CodeBlock { 0; }  # frozen
list_getitematindex_seems_to_be = List.GetItemAtIndex(list=watch_8@L2, index=code_block_27)  # "List.GetItemAtIndex - Seems to be more efficient"

# group (continued): inner Zick Zack
merge_zick_zack_lines_per = CodeBlock(linesDown=byStartPointEndPoint_5, linesUp=byStartPointEndPoint_6, numberOfSolids=dictToVar_4.numberOfSolids, numberOfLines=list_getitematindex_seems_to_be, linesStart=byStartPointEndPoint_7, linesEnd=byStartPointEndPoint_8)  # "Merge zick zack lines per element"
# ---------- merge_zick_zack_lines_per.designscript (22 lines) ----------
linesDown;
linesUp;
numberOfSolids;
numberOfLines;
linesStart;
linesEnd;
linesTotal = [Imperative]{
lines = [];
for (i in 0..numberOfSolids-1)
{
	l = [];
	l[0]=linesStart[i];
	for (j in 0..(numberOfLines[i]/2-2))
	{
		l[2*j+1] = linesDown[i][j];
		l[2*j+2] = linesUp[i][j];
	}
	l[numberOfLines[i]-1] = linesEnd[i];
	lines = List.AddItemToEnd(l,lines);
}
return lines;
};
# ----------------------------------------
merge_elements = CodeBlock(refLineOuter=transpose_3, refLineInner=transpose_4, zickZack=merge_zick_zack_lines_per.out6, numberOfSolids=dictToVar_4.numberOfSolids)
# ---------- merge_elements.designscript (45 lines) ----------
refLineOuter;
refLineInner;
zickZack;
numberOfSolids;
z = Vector.ZAxis();
outerEndPoints = Autodesk.DesignScript.Geometry.Curve.EndPoint(refLineOuter);
outerStartPoints = Autodesk.DesignScript.Geometry.Curve.StartPoint(refLineOuter);
innerEndPoints = Autodesk.DesignScript.Geometry.Curve.EndPoint(refLineInner);
innerStartPoints = Autodesk.DesignScript.Geometry.Curve.StartPoint(refLineInner);

totalZickZack = [Imperative]{
if (numberOfSolids == 1)
{
	return zickZack;
}
else {
	newZickZack=[];
	newZickZack = List.AddItemToEnd(zickZack[0],newZickZack);
	for (i in 1..numberOfSolids-1)
	{
		l = [];
		a = PolyCurve.TangentAtParameter(refLineOuter[i-1][0],1);
		b = PolyCurve.TangentAtParameter(refLineOuter[i][0],0);
		angle = Vector.AngleAboutAxis(a,b,z);
		if (angle < 180)
		{
			l1 = Line.ByStartPointEndPoint(outerEndPoints[i-1],innerEndPoints[i-1]);
			l2 = Line.ByStartPointEndPoint(innerEndPoints[i-1],innerStartPoints[i]);
			l3 = Line.ByStartPointEndPoint(innerStartPoints[i],outerStartPoints[i]);
			l = [l1,l2,l3];
		}
		else
		{
			l = [Line.ByStartPointEndPoint(outerEndPoints[i-1],outerStartPoints[i])];
		}
		newZickZack = List.AddItemToEnd(l,newZickZack);
		newZickZack = List.AddItemToEnd(zickZack[i],newZickZack);
	}


	return newZickZack;
}
};
tzickzack = List.Transpose(List.Flatten(totalZickZack,1));
zzPolyCurve = PolyCurve.ByJoinedCurves(tzickzack,0.001);
# ----------------------------------------
startPoint_6 = Curve.StartPoint(curve=merge_elements.out11)
parameterAtPoint_2 = Curve.ParameterAtPoint(curve=startCurve_2, point=startPoint_6)
trimByEndParameter_3 = Curve.TrimByEndParameter(curve=startCurve_2, endParameter=parameterAtPoint_2)
code_block_28 = CodeBlock(zickZack=merge_elements.out11, middleCurve=create_perimeter_offset_and_2.out10, firstPart=trimByEndParameter_3, sideBack=removesides_outer_perimeter.innerBorder, last=code_block_22.out2, connect=byStartPointEndPoint_4)
# ---------- code_block_28.designscript (5 lines) ----------
p1 = Autodesk.DesignScript.Geometry.Curve.EndPoint(zickZack);
p2 = Autodesk.DesignScript.Geometry.Curve.StartPoint(middleCurve);
zToMid = Line.ByStartPointEndPoint(p1,p2);
l = [firstPart,zickZack,zToMid,middleCurve,sideBack,last,connect];
PolyCurve.ByJoinedCurves(List.Transpose(l),0.01);
# ----------------------------------------
connect_inner_to_outer_path_2 = CodeBlock(accCurve=createAccess_2.accessCurve, innerPer=code_block_28.out4, outerPath=dictToVar_4.path, accIdx=dictToVar_4.accIdx)  # same code as connect_inner_to_outer_path

varToDict_2 = Custom[VarToDict](perimeter=code_block_26.out0, path=connect_inner_to_outer_path_2.out4, accIdx=code_block_26.out1, reversed=create_perimeter_offset_and_2.out2, numberOfSolids=merge_elements.out3, counter=code_block_26.out1, nozzleD=dictToVar_4.nozzleD)
watch_10 = Watch(code_block_25.out1)
watch_11 = Watch(pointsAtEqualSegmentLength_3)
