# Dynamo graph Test.dyn (Dynamo 2.10.1.3976)

select_model_elements_by = DSModelElementsByCategorySelection(index=686)  # "Select Model Elements By Category"; 2 picked in the model; frozen
watch = Watch(select_model_elements_by)
pick_evaluate_adjust = Custom[Pick_evaluate_adjust](dict=watch)  # Pick wall elelements, evaluate optimization opportunity, adjust layers and thicknesses
watch_2 = Watch(pick_evaluate_adjust.Error)
alert_Popout = Custom[Alert_Popout](Error=pick_evaluate_adjust.Elements_name, Error_Text=pick_evaluate_adjust.Elements)  # Show alerts from the code
watch_3 = Watch(pick_evaluate_adjust.Error_Text)
update_thicknesses = Custom[Update_thicknesses](dict=watch_3)  # Updating thicknesses of selected elements
code_block = CodeBlock { 0; 10; 5; 1; }
byCoordinates = Point.ByCoordinates(x=code_block.out0, y=code_block.out1, z=code_block.out0)
byCoordinates_2 = Point.ByCoordinates(x=code_block.out1, y=code_block.out1, z=code_block.out0)
list_create = List.Create(item0=byCoordinates, item1=byCoordinates_2)
byPoints = PolyCurve.ByPoints(points=list_create)
byCoordinates_3 = Point.ByCoordinates(x=code_block.out0, y=code_block.out2, z=code_block.out0)
byCoordinates_4 = Point.ByCoordinates(x=code_block.out1, y=code_block.out2, z=code_block.out0)
list_create_2 = List.Create(item0=byCoordinates_3, item1=byCoordinates_4)
byPoints_2 = PolyCurve.ByPoints(points=list_create_2)
byCoordinates_5 = Point.ByCoordinates(x=code_block.out0, y=code_block.out3, z=code_block.out0)
byCoordinates_6 = Point.ByCoordinates(x=code_block.out1, y=code_block.out3, z=code_block.out0)
list_create_3 = List.Create(item0=byCoordinates_5, item1=byCoordinates_6)
byPoints_3 = PolyCurve.ByPoints(points=list_create_3)
list_create_4 = List.Create(item0=byPoints, item1=byPoints_2, item2=byPoints_3)
list_create_5 = List.Create(item0=code_block.out1, item1=code_block.out2, item2=code_block.out2)
pointsAtEqualSegmentLength = Curve.PointsAtEqualSegmentLength(curve=list_create_4, divisions=list_create_5)
code_block_2 = CodeBlock { [2,2,2,2,2,2,4,18,18,9,9,9,4,4,4,9]; }  # frozen
code_block_3 = CodeBlock(PointsInput=code_block_2)
# ---------- code_block_3.designscript (15 lines) ----------
PointsInput;
LastValue = PointsInput[0];
PointsUnique = [Imperative]{
unique = [];
unique = List.AddItemToEnd(PointsInput[0], unique);
for (i in 0..(List.Count(PointsInput)-1))
{
	if(PointsInput[i] != LastValue)
	{
		unique = List.AddItemToEnd(PointsInput[i], unique);
		LastValue = PointsInput[i];
	}
}
return unique;
};
# ----------------------------------------
watch_4 = Watch(code_block_3.out2)
transpose = List.Transpose(lists=watch_4)
watch_5 = Watch(transpose)
